# Dynamo graph RoomConnectingSpline_ElementIDList.dyn (Dynamo 2.12.1.8246)
# packages: archi-lab.net 2022.210.2522

code_block_element_id_list = CodeBlock()  # "Code Block - element ID List EuclideanAllLevels"
# ---------- code_block_element_id_list.designscript (1 lines) ----------
[50419626, 50419768, 50419769, 50420301, 50420300, 50420299, 50420298, 50420297, 50420296, 50420747, 50419763, 50419717, 50419660, 50420227, 50420018, 50420889, 50420002, 50420125, 50420813, 50420001,
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
# ----------------------------------------
code_block_mrun005_14gen = CodeBlock()
# ---------- code_block_mrun005_14gen.designscript (1 lines) ----------
[50419776, 50419940, 50421077, 50421032, 50421052, 50421173, 50420721, 50420052, 50420149, 50419990, 50420215, 50420038, 50420058, 50421098, 50420933, 50421115, 50421033, 50419860, 50420479, 50420378,
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
# ----------------------------------------
element_by_id = ElementById(Id=code_block_mrun005_14gen)
location = Room.Location(room=element_by_id)
code_block = CodeBlock { false; }
byPoints = PolyCurve.ByPoints(points=location, connectLastToFirst=code_block)
geometry = Element.Geometry(element=element_by_id)
elements_in_room = Custom[Elements in Room]()  # package archi-lab.net; This node will check if any of the elements are inside any of the supplied rooms.; unwired: elements, rooms
elements_fom_linked_file_in_room = Custom[Elements Fom Linked File in Room]()  # package archi-lab.net; This node will check what elements from a linked model are inside of any of the rooms in the current model.; unwired: elements, rooms, linkInstance
code_block_element_ids = CodeBlock()  # "Code Block - Element IDs AllLevelsAllParams 20221205"
# ---------- code_block_element_ids.designscript (1 lines) ----------
[50421215, 50419710, 50419953, 50419879, 50420029, 50421220, 50420823, 50420864, 50421214, 50419928, 50420673, 50421132, 50420069, 50420856, 50420078, 50420120, 50420005, 50419797, 50421199, 50421202,
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
# ----------------------------------------
code_block_run004_gen_20 = CodeBlock()  # "Code Block - Run004 Gen#20 AllParamsAllLevelsMu=1"
# ---------- code_block_run004_gen_20.designscript (1 lines) ----------
[50421215, 50421077, 50419681, 50419941, 50421085, 50419874, 50420658, 50421201, 50419945, 50421199, 50420092, 50419707, 50420078, 50420853, 50419633, 50421230, 50420191, 50420675, 50420203, 50420123,
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
# ----------------------------------------
code_block_run005_gen_4 = CodeBlock()  # "Code Block - Run005 Gen#4 AllPAramsAllLevels"
# ---------- code_block_run005_gen_4.designscript (1 lines) ----------
[50419776, 50419940, 50421077, 50421032, 50421052, 50421173, 50420721, 50420052, 50420149, 50419990, 50420215, 50420038, 50420058, 50421098, 50420933, 50421115, 50421033, 50419860, 50420479, 50420378,
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
# ----------------------------------------
code_block_run005_gen_8 = CodeBlock()  # "Code Block Run005 Gen#8 AllPAramsAllLevels"
# ---------- code_block_run005_gen_8.designscript (1 lines) ----------
[50419776, 50419940, 50421077, 50421032, 50421052, 50421173, 50420721, 50420052, 50420149, 50419990, 50420215, 50420038, 50420058, 50421098, 50420933, 50421115, 50421033, 50419860, 50420479, 50420378,
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
# ----------------------------------------
